# Grasshopper definition 00_K-MeansSampleGH.gh (Grasshopper 1.0.7)

# ----
# Color Format
# Input
data = Data(1)
# Method
data_2 = Data(1)
# Output
data_3 = Data(1)
# Display
data_4 = Data(1)
# Unuse
data_5 = Data(1)

pt = Point([Point(11.42580299, 23.68521653, 0), Point(18.75106941, 14.43224843, 0), Point(41.62646278, 17.64508458, 0), Point(47.40956784, 28.31170059, 0), Point(43.04011068, 45.40398889, 0), Point(28.64660474, 50.80155362, 0)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])
pt_2 = Point(pt)

clusters = Slider(3, range=0..10)
# Step 0
lng = ListLength(List=pt_2)
subtraction = Subtraction(A=lng, B=clusters)
reduce = RandomReduce(List=pt_2, Reduction=subtraction, Seed=Slider(40, range=0..100))
cir = Circle(Plane=reduce, Radius="3")

# ----
# Step 1
pt_重心 = Point(reduce)
cir_2 = Circle(Plane=pt_重心, Radius="3")
cp = ClosestPoint(Point=pt_2, Cloud=pt_重心)  # -> ClosestPoint, CPIndex, Distance
boundary = BoundarySurfaces(Edges=cir_2)
series = Series(Start=0, Step=1, Count=clusters)
ln = Line(StartPoint=pt_2, EndPoint=cp.ClosestPoint)
int = Integer(series)
mindex = MemberIndex(Set=cp.CPIndex, Member=int)  # -> simplify(Index), Count
item = ListItem(List=pt_2, Index=mindex.Index, Wrap=True)
avr = Average(Input=item)
dist = Distance(PointA=avr, PointB=item)
flatten = FlattenTree(Tree=avr, Path="{0}")
ma = MassAddition(Input=flatten(dist))  # -> Result, PartialResults
int_2 = Integer(ma.Result)
vec2pt = Vector2Pt(PointA=pt_重心, PointB=flatten, Unitize=False)  # -> Vector, Length
cir_3 = Circle(Plane=flatten, Radius="2")
sse = Panel(int_2)
panel = Panel(vec2pt.Length)
vdisex = VectorDisplayEx(Point=pt_重心, Vector=vec2pt.Vector, Colour="Blue", Width=5)
pt_重心_2 = Point(flatten)
