# Grasshopper definition 01_K-MeansSample2D.gh (Grasshopper 1.0.7)
# plug-ins: LunchBoxML

# ----
# Color Format
# Input
data = Data(1)
# Method
data_2 = Data(1)
# Output
data_3 = Data(1)
# Display
data_4 = Data(1)
# Unuse
data_5 = Data(1)

rectangle = Rectangle(Plane=PlaneXY(0, 0, 0), XSize="100", YSize="100", Radius=0)  # -> Rectangle, Length

# ---- group: 1
pop2d = Populate2D(Region=rectangle.Rectangle, Count=100, Seed=1)

# ----
number_slider = Slider(5, range=0..10)
pt2num = PointsToNumbers(Points=graft(pop2d), Mask=2)  # -> simplify(Numbers)
series = Series(Start=0, Step=1, Count=number_slider)
k_means = KMeansClustering(TrainingInputs=pt2num, OfClusters=number_slider, RandomSeed=Slider(74, range=0..100))  # -> Result, Likelihood, Centroids
colbyval = ColbyVal(num=series)  # -> graft(col_2)
int = Integer(series)
mindex = MemberIndex(Set=k_means.Result, Member=int)  # -> Index, Count

# ---- group: 2
num2pt = NumbersToPoints(Numbers=k_means.Centroids, Mask=2)
cir = Circle(Plane=num2pt, Radius="3")

# ----
item = ListItem(List=pop2d, Index=mindex.Index, Wrap=True)
voronoi = Voronoi(Points=flatten(num2pt), Boundary=rectangle.Rectangle, BruteForceOverride=False)

# ---- group: 3
preview = CustomPreview(Geometry=item, Material=colbyval)

# ----
boundary = BoundarySurfaces(Edges=voronoi)  # -> graft(Surfaces)
argb = SplitARGB(Colour=colbyval)  # -> Alpha, Red, Green, Blue
frgb = ColourRGBF(Alpha="0.3", Red=argb.Red, Green=argb.Green, Blue=argb.Blue)

# ---- group: 4
preview_2 = CustomPreview(Geometry=boundary, Material=frgb)

# ==== cluster ColbyVal
num = ClusterInput()
num_2 = Number(num)
bnd = Bounds(Numbers=flatten(num_2))
remap = RemapNumbers(Value=num_2, Source=bnd, Target=Domain(0, 1))  # -> Mapped, Clipped
gradient = Gradient(
    LowerLimit=0,
    UpperLimit=1,
    Parameter=remap.Mapped,
    stops=[0: RGB(234, 38, 0), 0.25: RGB(234, 126, 0), 0.5: RGB(254, 244, 84), 0.75: RGB(173, 203, 249), 1: RGB(75, 107, 169)])
col = Colour(gradient)
col_2 = ClusterOutput(col)
