# Grasshopper definition 02_K-MeansSample3D.gh (Grasshopper 1.0.7)
# plug-ins: LunchBoxML

# ----
# Color Format
# Input
data = Data(1)
# Method
data_2 = Data(1)
# Output
data_3 = Data(1)
# Display
data_4 = Data(1)
# Unuse
data_5 = Data(1)

box = DomainBox(Base=PlaneXY(0, 0, 0), X="100", Y="100", Z="100")

# ---- group: 1
pop3d = Populate3D(Region=box, Count=100, Seed=1)

# ----
number_slider = Slider(5, range=0..10)
pt2num = PointsToNumbers(Points=graft(pop3d), Mask=4)  # -> simplify(Numbers)
series = Series(Start=0, Step=1, Count=number_slider)
k_means = KMeansClustering(TrainingInputs=pt2num, OfClusters=number_slider, RandomSeed=5)  # -> Result, Likelihood, Centroids
colbyval = ColbyVal(num=series)  # -> graft(col_2)
int = Integer(series)
mindex = MemberIndex(Set=k_means.Result, Member=int)  # -> Index, Count
num2pt = NumbersToPoints(Numbers=k_means.Centroids, Mask=4)

# ---- group: 2
sph = Sphere(Base=num2pt, Radius="3")

# ----
voronoi³ = Voronoi3D(Points=flatten(num2pt), Box=box)  # -> graft(Cells), Boundary
item = ListItem(List=pop3d, Index=mindex.Index, Wrap=True)
argb = SplitARGB(Colour=colbyval)  # -> Alpha, Red, Green, Blue

# ---- group: 3
preview = CustomPreview(Geometry=item, Material=colbyval)

# ----
frgb = ColourRGBF(Alpha="0.1", Red=argb.Red, Green=argb.Green, Blue=argb.Blue)

# ---- group: 4
preview_2 = CustomPreview(Geometry=voronoi³.Cells, Material=frgb)

# ==== cluster ColbyVal
num = ClusterInput()
num_2 = Number(num)
bnd = Bounds(Numbers=flatten(num_2))
remap = RemapNumbers(Value=num_2, Source=bnd, Target=Domain(0, 1))  # -> Mapped, Clipped
gradient = Gradient(
    LowerLimit=0,
    UpperLimit=1,
    Parameter=remap.Mapped,
    stops=[0: RGB(234, 38, 0), 0.25: RGB(234, 126, 0), 0.5: RGB(254, 244, 84), 0.75: RGB(173, 203, 249), 1: RGB(75, 107, 169)])
col = Colour(gradient)
col_2 = ClusterOutput(col)
