# Grasshopper definition 03_K-MeansSample6D.gh (Grasshopper 1.0.7)
# plug-ins: LunchBoxML

# ----
# Color Format
# Input
data = Data(1)
# Method
data_2 = Data(1)
# Output
data_3 = Data(1)
# Display
data_4 = Data(1)
# Unuse
data_5 = Data(1)

box = DomainBox(Base=PlaneXY(0, 0, 0), X="1000", Y="1000", Z="1000")
box_2 = DomainBox(Base=PlaneXY(0, 0, 0), X="-100 to 100", Y="-100 to 100", Z="-100 to 100")
pop3d = Populate3D(Region=box, Count=100, Seed=1)
pop3d_2 = Populate3D(Region=box_2, Count=100, Seed="10")
pt = Point(pop3d)
vec = Vector(pop3d_2)
sph = Sphere(Base=pt, Radius="20")

# ----
# Display
preview = CustomPreview(Geometry=sph, Material="pink")
vdisex = VectorDisplayEx(Point=pt, Vector=vec, Colour="pink", Width="3")

pt_2 = Point(pt)
vec_2 = Vector(vec)
pt2num = PointsToNumbers(Points=graft(vec_2), Mask=4)  # -> simplify(Numbers)
pt2num_2 = PointsToNumbers(Points=graft(pt_2), Mask=4)  # -> simplify(Numbers)
merge = Merge(Data1=pt2num_2, Data2=pt2num)
flip = FlipMatrix(Data=merge)
panel = Panel(merge)
bnd = Bounds(Numbers=flip)
remap = RemapNumbers(Value=flip, Source=bnd, Target=Domain(0, 1))  # -> Mapped, Clipped
flip_2 = FlipMatrix(Data=remap.Mapped)
number_slider = Slider(10, range=0..10)
panel_2 = Panel(flip_2)
k_means = KMeansClustering(TrainingInputs=merge, OfClusters=number_slider, RandomSeed=5)  # -> Result, Likelihood, Centroids
series = Series(Start=0, Step=1, Count=number_slider)
int = Integer(series)
colbyval = ColbyVal(num=int)  # -> simplify(graft(col_2))
mindex = MemberIndex(Set=k_means.Result, Member=int)  # -> simplify(Index), Count
item = ListItem(List=vec_2, Index=mindex.Index, Wrap=True)
item_2 = ListItem(List=pt_2, Index=mindex.Index, Wrap=True)
sph_2 = Sphere(Base=item_2, Radius="20")

# ----
# Display
preview_2 = CustomPreview(Geometry=sph_2, Material=colbyval)
vdisex_2 = VectorDisplayEx(Point=item_2, Vector=item, Colour=colbyval, Width="5")

# ==== cluster ColbyVal
num = ClusterInput()
num_2 = Number(num)
bnd = Bounds(Numbers=flatten(num_2))
remap = RemapNumbers(Value=num_2, Source=bnd, Target=Domain(0, 1))  # -> Mapped, Clipped
gradient = Gradient(
    LowerLimit=0,
    UpperLimit=1,
    Parameter=remap.Mapped,
    stops=[0: RGB(234, 38, 0), 0.25: RGB(234, 126, 0), 0.5: RGB(254, 244, 84), 0.75: RGB(173, 203, 249), 1: RGB(75, 107, 169)])
col = Colour(gradient)
col_2 = ClusterOutput(col)
