# Grasshopper definition 04_K-MeansSample10D.gh (Grasshopper 1.0.7)
# plug-ins: LunchBoxML, LunchBox

# ----
# Color Format
# Input
data = Data(1)
# Method
data_2 = Data(1)
# Output
data_3 = Data(1)
# Display
data_4 = Data(1)
# Unuse
data_5 = Data(1)

アンケート結果 = Panel("""No,Name,Q1,Q2,Q3,Q4,Q5,Q6,Q7,Q8,Q9,Q10
0,You,0,0,0,0,0,0,0,0,0,0
1,Akira,0,0,0,0,0,0,0,1,0,1
2,Bruno,0,1,0,1,1,1,1,0,0,1
3,Chihiro,0,0,1,1,1,1,1,0,0,0
4,Daiki,0,0,1,0,1,1,1,0,0,1
5,Emiko,1,0,1,1,1,1,1,0,0,0
6,Fumiko,0,1,0,0,0,1,0,1,0,1
7,Goro,1,1,1,1,1,0,1,1,0,0
8,Haruki,0,1,0,1,1,0,1,0,0,0
9,Ichiro,0,1,1,0,0,1,1,0,0,1
10,Junko,1,0,0,0,1,1,1,1,1,0
11,Keiko,1,0,1,1,1,1,1,1,1,0
12,Leo,0,0,0,0,1,1,1,0,0,1
13,Mika,0,0,1,0,1,1,1,0,0,0
14,Naoko,1,1,0,1,1,0,1,0,1,1
15,Osamu,1,0,0,1,0,1,1,1,1,0
16,Paul,0,1,1,1,1,1,1,0,0,0
17,Quinn,1,1,1,1,1,1,1,1,0,1
18,Reisyu,0,0,1,1,1,0,0,1,0,1
19,Sora,1,1,1,0,0,1,0,0,0,0
20,Takumi,1,0,1,0,1,1,0,1,1,1
21,Uta,1,1,0,0,0,0,1,0,1,1
22,Victor,0,0,1,1,0,0,0,1,0,1
23,Wataru,0,1,1,0,1,0,1,0,0,1
24,Xander,1,0,0,0,0,0,0,0,1,1
25,Yuko,1,0,0,0,0,0,0,1,1,1
26,Zoe,0,0,0,1,1,0,1,1,1,1
27,Asuka,1,1,0,0,0,0,0,0,0,0
28,Ben,0,1,1,1,0,1,0,1,1,1
29,Clara,0,1,0,1,0,0,0,1,1,1
30,Daisuke,1,0,1,0,1,1,1,1,1,0
31,Eri,1,0,0,0,1,0,0,0,0,0
32,Futoshi,0,0,1,1,0,0,1,0,1,0
33,Grace,1,0,1,0,0,0,1,1,0,0
34,Hiro,0,0,0,1,0,1,1,1,1,0
35,Izumi,1,0,0,1,0,1,0,0,0,0
36,Jun,0,0,1,0,1,0,1,1,1,1
37,Kaori,0,1,0,1,0,1,0,0,0,1
38,Lucas,0,0,1,1,0,1,1,1,0,0
39,Mei,1,1,1,1,0,1,0,1,1,0
40,Nori,1,1,1,0,0,1,1,1,0,1
41,Olivia,1,1,1,1,1,1,0,0,1,0
42,Patrick,0,1,1,0,0,0,1,1,0,0
43,Quentin,1,0,0,0,1,0,0,1,0,0
44,Reiko,0,1,1,1,1,0,1,1,0,0
45,Shinji,0,1,0,0,0,0,0,0,1,1
46,Tsubasa,1,0,1,0,0,1,0,1,1,0
47,Ume,0,1,0,0,1,0,1,1,1,0
48,Vanessa,0,1,1,1,0,1,1,0,0,1
49,Wakana,1,1,0,1,0,1,1,1,0,1
50,Yasu,1,0,1,1,1,1,1,1,0,1
51,Aoi,1,1,1,0,1,1,0,0,0,0
52,Bill,0,1,0,0,0,1,1,0,0,0
53,Chieko,1,0,0,0,0,0,0,0,0,0
54,Daigo,0,1,1,1,0,1,1,1,0,1
55,Elena,1,1,1,1,1,0,0,1,0,1
56,Fumi,1,1,1,1,1,0,1,0,0,0
57,Gen,1,1,0,1,0,0,1,1,1,0
58,Hana,1,0,0,0,1,1,1,0,0,1
59,Itsuki,0,0,0,0,0,1,1,1,1,0
60,Joji,1,1,0,0,1,0,0,1,0,1
61,Kazuki,1,0,1,1,1,1,1,0,1,0
62,Lisa,0,1,0,0,0,1,1,1,0,1
63,Mizue,0,1,0,0,0,1,1,1,1,1
64,Naomi,0,0,1,1,1,1,0,1,0,1
65,Oliver,0,1,1,1,0,1,1,0,1,1
66,Peter,1,1,0,1,0,1,1,0,1,0
67,Quentin,0,0,1,1,1,1,0,0,1,0
68,Reika,1,0,0,0,0,0,1,0,1,1
69,Shota,0,1,1,0,1,1,0,1,0,1
70,Taku,0,1,1,0,1,1,0,0,1,1
71,Umeko,1,0,1,1,1,1,1,0,1,1
72,Vicky,0,0,0,1,0,0,0,0,1,0
73,Walter,0,1,1,0,1,0,1,1,1,0
74,Xavier,1,0,0,1,1,0,1,1,0,0
75,Yumi,0,1,1,0,1,1,0,0,0,1
76,Zach,0,0,0,1,0,0,0,1,0,1
77,Ami,1,0,1,0,1,0,0,0,1,0
78,Bob,1,1,0,0,1,0,1,1,0,1
79,Chika,1,0,0,0,0,1,0,0,0,1
80,Dai,0,1,0,0,0,0,1,1,0,1
81,Etsuko,1,0,0,1,0,0,0,1,0,1
82,Fumiya,0,1,1,0,0,0,1,0,0,1
83,Gaku,0,0,1,0,1,0,1,0,1,0
84,Hiroko,1,0,0,1,0,0,0,1,1,1
85,Ikuo,1,0,1,1,0,1,1,0,0,1
86,Junko,0,0,0,1,1,0,0,0,1,0
87,Kenji,1,0,1,0,0,0,1,0,0,1
88,Leo,0,1,0,1,1,0,1,1,1,1
89,Maki,0,0,1,1,0,0,0,0,1,0
90,Naoki,0,0,0,1,1,1,0,1,0,0
91,Oscar,0,0,0,0,1,0,0,1,1,1
92,Paula,0,0,0,1,1,0,1,1,1,1
93,Queen,1,1,0,1,1,1,1,1,1,0
94,Ryu,0,1,0,0,0,0,1,1,0,0
95,Sakura,1,0,1,0,0,1,1,0,0,1
96,Tadashi,0,0,1,1,1,0,1,0,1,0
97,Ueno,0,1,0,0,1,1,1,0,0,1
98,Vivian,1,0,1,1,0,0,0,0,0,0
99,Wayne,0,0,0,0,1,0,1,1,1,0
100,Yoko,1,0,1,0,1,1,1,1,1,1
101,Zumi,1,0,0,0,0,0,1,0,0,1
102,Asami,1,0,0,1,0,0,0,1,1,0
103,Brett,0,0,1,0,0,0,0,0,0,1
104,Chiemi,0,0,1,0,0,0,0,0,1,0
105,Daisuke,0,0,1,1,0,1,0,1,1,0
106,Erina,0,1,0,0,0,1,1,1,0,0
107,Fumito,0,0,0,0,0,1,1,0,0,1
108,Goro,1,1,1,0,1,1,0,0,0,0
109,Haru,1,0,1,0,1,1,0,1,0,0
110,Ichika,1,1,0,0,1,1,1,0,1,0
111,Jiro,0,0,0,0,1,0,0,0,1,0
112,Kana,0,0,1,0,0,1,0,0,1,0
113,Leo,0,0,1,1,1,1,0,1,1,0
114,Mai,0,1,1,1,1,1,0,1,1,1
115,Nao,1,0,0,0,1,1,1,0,1,0
116,Orie,0,0,0,0,1,1,0,0,0,1
117,Paul,1,1,0,1,1,1,1,1,0,0
118,Queenie,1,1,0,0,1,0,0,0,0,1
119,Ryoji,1,1,1,1,1,0,0,0,1,1
120,Sayaka,1,1,0,0,1,1,1,0,0,1
121,Takashi,0,0,0,1,0,0,0,0,0,0
122,Uta,0,1,0,0,0,0,0,1,0,1
123,Victor,0,0,0,0,0,0,1,1,0,0
124,Wakako,0,1,1,1,0,1,0,1,0,0
125,Yuta,0,1,0,1,0,1,1,0,1,0
126,Zen,0,1,0,0,0,0,1,1,0,1
127,Aiko,0,0,1,0,0,0,1,0,1,0
128,Brian,1,1,0,1,1,1,1,1,1,0
129,Chiharu,1,1,1,0,0,1,0,0,1,0
130,Daisuke,0,1,0,1,0,0,0,0,1,1
131,Eiko,0,1,0,0,0,0,1,0,1,0
132,Fumiaki,1,0,1,1,1,1,0,0,1,1
133,Genki,1,1,0,0,0,0,1,0,0,0
134,Hiroshi,0,1,1,0,1,1,0,0,1,0
135,Ikumi,0,0,0,0,0,1,1,0,0,0
136,Junichi,0,0,1,0,1,0,1,1,0,0
137,Kazuo,1,0,1,1,0,1,1,1,1,0
138,Lina,1,0,0,0,1,0,1,1,1,0
139,Makoto,1,0,0,0,1,1,1,0,1,1
140,Natsuki,0,0,1,0,0,0,1,1,1,1
141,Otome,0,1,0,1,0,0,0,1,0,1
142,Paula,0,0,1,0,0,1,1,0,0,1
143,Quill,0,1,0,1,1,0,0,0,1,1
144,Rina,0,1,0,1,1,1,0,1,0,0
145,Seiji,1,0,1,0,0,0,0,0,1,1
146,Taka,0,1,1,1,0,1,1,1,1,0
147,Umi,1,1,1,1,1,1,0,0,1,0
148,Vince,1,0,1,1,1,1,0,0,0,0
149,Wako,1,0,1,0,1,0,0,1,1,0
150,Yuzuki,0,0,0,1,1,1,0,1,1,1
151,Zara,0,0,1,1,1,1,0,0,1,0
152,Akane,0,1,1,1,0,1,0,1,1,0
153,Billy,0,1,1,1,0,0,0,0,0,0
154,Chizuru,1,1,0,0,1,0,0,0,0,0
155,Daiki,0,0,0,1,1,1,0,1,1,0
156,Ema,0,1,1,1,1,1,1,0,0,0
157,Fuyuki,1,1,1,1,1,0,0,0,0,0
158,Genta,1,0,0,1,0,1,1,1,0,1
159,Hikaru,1,0,1,1,1,0,0,1,0,1
160,Iori,0,1,0,1,1,1,0,0,1,0
161,Junya,0,0,0,0,0,1,0,0,1,0
162,Keita,1,1,0,0,1,0,0,1,1,1
163,Luna,0,0,1,0,1,1,1,0,1,1
164,Manabu,1,0,1,1,1,0,1,1,0,0
165,Naoya,0,1,0,0,0,0,1,1,1,1
166,Otaro,0,1,0,0,1,0,0,1,1,0
167,Petra,0,1,0,0,1,0,0,1,1,1
168,Quincy,0,1,1,0,0,1,0,1,1,0
169,Rio,0,0,0,0,1,1,0,0,0,0
170,Saki,0,1,0,1,0,1,0,0,0,1
171,Takeru,0,0,0,0,1,1,1,1,1,0
172,Ume,1,1,0,0,1,0,0,1,0,1
173,Val,0,1,0,1,1,1,1,1,1,0
174,Wataru,0,1,1,1,0,0,1,0,1,0
175,Yuya,1,1,1,1,1,1,1,0,1,0
176,Zack,1,0,0,1,0,1,0,0,1,1
177,Aya,1,1,1,0,0,1,0,0,0,1
178,Bob,1,1,0,1,0,1,1,1,1,1
179,Chie,1,0,0,1,0,0,1,1,1,0
180,Daichi,1,0,1,0,0,0,1,1,1,0
181,Emiri,0,0,1,0,0,1,0,0,0,1
182,Fumi,0,1,0,1,1,1,1,1,1,1
183,Gen,0,1,0,0,0,1,0,1,1,0
184,Hiromi,1,0,1,1,0,1,1,0,0,1
185,Issei,1,1,0,0,1,1,1,1,0,0
186,Junpei,0,0,1,0,1,1,1,1,0,0
187,Koji,0,1,1,1,0,0,0,0,0,1
188,Leo,0,0,1,0,1,0,0,0,1,1
189,Mariko,1,1,0,0,1,0,1,1,0,1
190,Nozomi,1,0,0,1,1,1,1,1,1,1
191,Oto,0,0,0,0,1,0,1,0,1,1
192,Pia,1,1,0,1,0,1,0,1,0,0
193,Queen,0,0,0,0,0,1,1,1,0,1
194,Riku,0,0,0,1,1,0,1,1,0,0
195,Satoru,1,1,0,1,1,0,1,0,0,1
196,Tatsuya,1,1,0,1,0,0,0,0,1,0
197,Ueno,0,0,0,1,1,0,0,0,1,1
198,Vanessa,1,1,0,1,0,0,1,0,0,1
199,Wakaba,0,1,0,0,0,0,1,0,0,1
200,Yuzo,0,0,0,1,1,1,0,1,1,0""")
# アンケート結果
アンケート = Panel("""Q1: コーヒーは毎日飲みますか？
Q2: 早起きは得意ですか？
Q3: SNSを毎日利用しますか？
Q4: 運転することが好きですか？
Q5: 定期的な運動は苦手ですか？
Q6: 料理よりも外食を好む傾向がありますか？
Q7: 冬の寒さより夏の暑さの方が好きですか？
Q8: 新しい技術やガジェットに興味がありますか？
Q9: 自然と触れ合うアウトドア活動が好きですか？
Q10: 映画よりも本を読むことを好む傾向がありますか？""")

# ----
# データの整理
split = SplitList(List=アンケート結果, Index="1")  # -> simplify(ListA), simplify(ListB)
panel = Panel(split.ListA)
split_2 = TextSplit(Text=split.ListB, Separators=",")  # -> simplify(Result)
split_3 = SplitList(List=split_2, Index="2")  # -> simplify(ListA), simplify(ListB)
panel_2 = Panel(split_3.ListB)
panel_3 = Panel(split_3.ListA)
num_回答 = Number(split_3.ListB)
txt_name = Text(split_3.ListA)

# ----
# Input
number_slider = Slider(6, range=2..10)

# ----
# K-Means法によるクラスタリング
panel_4 = Panel(",")
k_means = KMeansClustering(TrainingInputs=num_回答, OfClusters=number_slider, RandomSeed=Slider(0, range=0..100))  # -> Result, Likelihood, Centroids
join = TextJoin(Text=num_回答, Join=panel_4)  # -> flatten(Result)
join_2 = TextJoin(Text=txt_name, Join=panel_4)  # -> flatten(Result)
int_result = Integer(flatten(k_means.Result))

# ----
# クラスターごとにデータを振り分ける
sort_val = SortDuplicateValues(ValueList=int_result)  # -> UniqueValues, Indices
item = ListItem(List=join_2, Index=sort_val.Indices, Wrap=True)  # -> simplify(Item)
item_2 = ListItem(List=join, Index=sort_val.Indices, Wrap=True)  # -> simplify(Item)
int_result_2 = Integer(sort_val.UniqueValues)
txt_nmae = Text(item)
txt_回答 = Text(item_2)

# ----
# クラスターごとの塗分け色を作成する
bnd = Bounds(Numbers=int_result_2)
remap = RemapNumbers(Value=int_result_2, Source=bnd, Target="0.9")  # -> Mapped, Clipped
gradient = Gradient(
    LowerLimit=0,
    UpperLimit=1,
    Parameter=remap.Clipped,
    stops=[0: RGB(243, 57, 0), 0.1: RGB(236, 27, 60), 0.2: RGB(210, 0, 118), 0.3: RGB(103, 0, 120), 0.4: RGB(39, 72, 161), 0.5: RGB(1, 192, 229), 0.6: RGB(18, 178, 90), 0.7: RGB(79, 186, 8), 0.8: RGB(220, 237, 32), 0.9: RGB(247, 159, 20), 1: RGB(243, 57, 0)])
col = Colour(simplify(graft(gradient)))

# ----
# レーダーチャートの並べ方
list = ValueList({"Tower": 0, "Ring": 1}, selected="Tower")

# ----
# レーダーチャートを作成する
split_4 = TextSplit(Text=txt_回答, Separators=",")
tstat = TreeStatistics(Tree=split_4)  # -> Paths, Length, Count
remap_2 = RemapNumbers(Value=split_4, Source=Domain(0, 1), Target="20 to 100")  # -> Mapped, Clipped
series = Series(Start=0, Step="6", Count=tstat.Count)  # -> simplify(graft(Series))
item_3 = ListItem(List=tstat.Length, Index=0, Wrap=True)
Z = UnitZ(Factor=series)
division = Division(A="Pi*2", B=item_3)
xy = XYPlane(Origin=Z)
series_2 = Series(Start=0, Step=division, Count=item_3)
match = MatchTree(Tree=xy, Guide=remap_2.Mapped)
suirify = Suirify(series_2)
pt = PointCylindrical(BasePlane=match, Angle=suirify, Radius=remap_2.Mapped, Elevation=0)  # -> simplify(Point)
pline = PolyLine(Vertices=pt, Closed="true")
Z_2 = UnitZ(Factor="5")
boundary = BoundarySurfaces(Edges=pline)
pt_2 = Point(Point(0, 0, 100))
cir = Circle(Plane=pt_2, Radius="300")
extr = Extrude(Base=boundary, Direction=Z_2)
pframes = PerpFrames(Curve=cir, Count=tstat.Count, Align=True)  # -> Frames, Parameters
orient = Orient(Geometry=flatten(extr), Source=flatten(match), Target=flatten(pframes.Frames))  # -> Geometry, Transform
# Display
filter = StreamFilter(Gate=list, Stream0=flatten(extr), Stream1=flatten(orient.Geometry))
filter_2 = StreamFilter(Gate=list, Stream0=flatten(match), Stream1=flatten(pframes.Frames))

pt_3 = PointOriented(BasePlane=filter_2, UComponent="105", VComponent=0, WComponent=0)
pl_origin = PlaneOrigin(Base=filter_2, Origin=pt_3)
unflatten = UnflattenTree(Tree=pl_origin, Guide=txt_nmae)
unflatten_2 = UnflattenTree(Tree=filter, Guide=txt_nmae)
material = CreateMaterial(Diffuse=col, Specular=RGB(255, 255, 255), Emission=RGB(0, 0, 0), Transparency="0.8", Shine=0)
tag = TextTag3D(Location=unflatten, Text=txt_nmae, Size="5", Colour=col, Justification=4)
preview = CustomPreview(Geometry=unflatten_2, Material=material)
